# Grasshopper definition 11-8 Ameba-2.gh (Grasshopper 1.0.7)
# plug-ins: AmebaMesh, Ameba

number_slider = Slider(3, range=0..10)
number_slider_2 = Slider(20, range=0..100)
range = Range(Domain=Domain(0, 1), Steps=number_slider_2)
number_slider_3 = Slider(10, range=0..10)
graph_mapper = GraphMapper(
    range,
    x0=0,
    x1=1,
    y0=0,
    y1=1,
    container_name="Bezier",
    cpx=[0, 0.1503923982, 0.5941604376, 1],
    cpy=[0, 0.6294228435, 0.2630332112, 0])
curve = Curve([<curve referenced from the Rhino model> x2])
bounds = Bounds(Numbers=graph_mapper)
divide_curve = DivideCurve(Curve=curve, Count=number_slider_2, Kinks=False)  # -> Points, Tangents, Parameters
construct_domain = ConstructDomain(DomainStart=Slider(0, range=0..100), DomainEnd=Slider(23, range=0..100))
remap_numbers = RemapNumbers(Value=graph_mapper, Source=bounds, Target=construct_domain)  # -> Mapped, Clipped
negative = Negative(Value=remap_numbers.Mapped)
unit_z = UnitZ(Factor=negative)
move = Move(Geometry=divide_curve.Points, Motion=unit_z)  # -> Geometry, Transform
interpolate = Interpolate(Vertices=move.Geometry, Degree=3, Periodic=False, KnotStyle=1)  # -> Curve, Length, Domain
number_slider_4 = Slider(24.79, range=0..100)

# ---- group: 风荷载
number_slider_5 = Slider(24.79, range=0..100)

# ----
number_slider_6 = Slider(24.79, range=0..100)
multiplication = Multiplication(A=number_slider_4, B=Slider(2, range=0..10))
number_slider_7 = Slider(24.79, range=0..100)
number_slider_8 = Slider(24.79, range=0..100)
negative_2 = Negative(Value=multiplication)
multiplication_2 = Multiplication(A=number_slider_5, B=Slider(2, range=0..10))
number_slider_9 = Slider(0, range=0..100)
number_slider_10 = Slider(1, range=0..1)
multiplication_3 = Multiplication(A=number_slider_6, B=Slider(4, range=0..10))
surfaces = Surfaces(SurfaceData_Branch0_Path="{0}")
multiplication_4 = Multiplication(A=number_slider_7, B=Slider(4, range=0..10))
surfaces_2 = Surfaces(SurfaceData_Branch0_Path="{0}")
surfaces_3 = Surfaces(SurfaceData_Branch0_Path="{0}")
negative_3 = Negative(Value=number_slider_4)
negative_4 = Negative(Value=multiplication_2)
brep = Brep(<brep referenced from the Rhino model>)
brep_2 = Brep(<brep referenced from the Rhino model>)
brep_3 = Brep(<brep referenced from the Rhino model>)
brep_4 = Brep(<brep referenced from the Rhino model>)
brep_5 = Brep(<brep referenced from the Rhino model>)
surfaces_4 = Surfaces(SurfaceData_Branch0_Path="{0}")
negative_5 = Negative(Value=multiplication_3)
multiplication_5 = Multiplication(A=number_slider_8, B=Slider(4, range=0..10))
surfaces_5 = Surfaces(SurfaceData_Branch0_Path="{0}")
number_slider_11 = Slider(1, range=0..1)
number_slider_12 = Slider(1, range=0..1)
number_slider_13 = Slider(0, range=0..100)
multiplication_6 = Multiplication(A=Slider(2.03, range=0..100), B=Slider(3, range=0..10))
negative_6 = Negative(Value=multiplication_4)
c50混凝土密度 = Slider(2251, range=0..10000)
c50混凝土弹性模量 = Slider(3.45, range=0..10)
c50混凝土泊松比 = Slider(0.3, range=0..1)
curvesdomain = CurvesDomain(CurveData_Branch0_Path="{0}", CurveData_Branch0_Item0_EdgeIndex=-1)
curvesdomain_2 = CurvesDomain(CurveData_Branch0_Path="{0}", CurveData_Branch0_Item0_EdgeIndex=-1)
negative_7 = Negative(Value=multiplication_4)
surfaces_6 = Surfaces(SurfaceData_Branch0_Path="{0}")
curvesdomain_3 = CurvesDomain(CurveData_Branch0_Path="{0}", CurveData_Branch0_Item0_EdgeIndex=-1)
curvesdomain_4 = CurvesDomain(CurveData_Branch0_Path="{0}", CurveData_Branch0_Item0_EdgeIndex=-1)
surfaces_7 = Surfaces(SurfaceData_Branch0_Path="{0}")
surfaces_8 = Surfaces(SurfaceData_Branch0_Path="{0}")
curvesdomain_5 = CurvesDomain(CurveData_Branch0_Path="{0}", CurveData_Branch0_Item0_EdgeIndex=-1)
curvesdomain_6 = CurvesDomain(CurveData_Branch0_Path="{0}", CurveData_Branch0_Item0_EdgeIndex=-1)
curvesdomain_7 = CurvesDomain(CurveData_Branch0_Path="{0}", CurveData_Branch0_Item0_EdgeIndex=-1)
pointsdomain = PointsDomain(pointsData_Branch0_Path="{0}", pointsData_Branch0_Item0_Coordinate=Point(-33046.18617, -75652.92253, 381.6101255))
number_slider_14 = Slider(0, range=0..100)
number_slider_15 = Slider(1, range=0..1)
pointsdomain_2 = PointsDomain(
    pointsData_Branch0_Path="{0}",
    pointsData_Branch0_Item0_Coordinate=Point(1030.608553, 1179.664518, 500),
    pointsData_Branch0_Item1_Coordinate=Point(1018.939496, 1143.1828, 500),
    pointsData_Branch0_Item2_Coordinate=Point(1061.550143, 1169.787655, 500),
    pointsData_Branch0_Item3_Coordinate=Point(1069.709086, 1112.666959, 450),
    pointsData_Branch0_Item4_Coordinate=Point(1064.355659, 1103.815564, 400),
    pointsData_Branch0_Item5_Coordinate=Point(1058.128704, 1098.913803, 350),
    pointsData_Branch0_Item6_Coordinate=Point(1050.87686, 1098.255538, 300),
    pointsData_Branch0_Item7_Coordinate=Point(1042.410493, 1102.246343, 250),
    pointsData_Branch0_Item8_Coordinate=Point(1032.486957, 1111.466269, 200),
    pointsData_Branch0_Item9_Coordinate=Point(1020.78771, 1126.789336, 150),
    pointsData_Branch0_Item10_Coordinate=Point(1006.881041, 1149.640033, 100),
    pointsData_Branch0_Item11_Coordinate=Point(990.1575171, 1182.65244, 50),
    pointsData_Branch0_Item12_Coordinate=Point(979.8047197, 1206.185326, 23.36748552),
    pointsData_Branch0_Item13_Coordinate=Point(1088.976705, 1225.973458, 23.36748552),
    pointsData_Branch0_Item14_Coordinate=Point(1069.942813, 1218.371301, 50),
    pointsData_Branch0_Item15_Coordinate=Point(1042.044718, 1201.719567, 100),
    pointsData_Branch0_Item16_Coordinate=Point(1022.10018, 1182.260151, 150),
    pointsData_Branch0_Item17_Coordinate=Point(1008.369928, 1162.46428, 200),
    pointsData_Branch0_Item18_Coordinate=Point(999.7320949, 1146.397956, 250),
    pointsData_Branch0_Item19_Coordinate=Point(995.4305334, 1135.737347, 300),
    pointsData_Branch0_Item20_Coordinate=Point(994.9493836, 1129.596069, 350),
    pointsData_Branch0_Item21_Coordinate=Point(997.9151662, 1126.684103, 399.627982),
    pointsData_Branch0_Item22_Coordinate=Point(1004.245676, 1125.999263, 450),
    pointsData_Branch0_Item23_Coordinate=Point(1024.683475, 1186.975989, 450),
    pointsData_Branch0_Item24_Coordinate=Point(1021.260402, 1192.332692, 400),
    pointsData_Branch0_Item25_Coordinate=Point(1021.080628, 1195.410017, 350),
    pointsData_Branch0_Item26_Coordinate=Point(1025.045415, 1195.794022, 300),
    pointsData_Branch0_Item27_Coordinate=Point(1033.996587, 1192.94984, 250),
    pointsData_Branch0_Item28_Coordinate=Point(1048.102573, 1186.181833, 200)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)
negative_8 = Negative(Value=Slider(2.03, range=0..100))
surfaces_9 = Surfaces(SurfaceData_Branch0_Path="{0}")
surfaces_10 = Surfaces(SurfaceData_Branch0_Path="{0}")
surfaces_11 = Surfaces(SurfaceData_Branch0_Path="{0}")
surfaces_12 = Surfaces(SurfaceData_Branch0_Path="{0}")
surfaces_13 = Surfaces(SurfaceData_Branch0_Path="{0}")

negative_9 = Negative(Value=number_slider_5)
curvesdomain_8 = CurvesDomain(CurveData_Branch0_Path="{0}", CurveData_Branch0_Item0_EdgeIndex=-1)
curvesdomain_9 = CurvesDomain(CurveData_Branch0_Path="{0}", CurveData_Branch0_Item0_EdgeIndex=-1)
curvesdomain_10 = CurvesDomain(CurveData_Branch0_Path="{0}", CurveData_Branch0_Item0_EdgeIndex=-1)
curvesdomain_11 = CurvesDomain(CurveData_Branch0_Path="{0}", CurveData_Branch0_Item0_EdgeIndex=-1)
load3d = Load3D(Domain=curvesdomain_8, Fx=negative_4, Fy=multiplication_2, Fz=0)
load3d_2 = Load3D(Domain=curvesdomain_9, Fx=negative_9, Fy=0, Fz=0)
load3d_3 = Load3D(Domain=curvesdomain_11, Fx=0, Fy=number_slider_5, Fz=0)
load3d_4 = Load3D(Domain=curvesdomain_10, Fx=0, Fy=number_slider_5, Fz=0)

surfaces_14 = Surfaces(SurfaceData_Branch0_Path="{0}")
multiplication_7 = Multiplication(A=Slider(2.03, range=0..100), B=Slider(2, range=0..10))
negative_10 = Negative(Value=number_slider_6)
negative_11 = Negative(Value=multiplication_5)
brep_6 = Brep(<brep referenced from the Rhino model>)
brep_7 = Brep(<brep referenced from the Rhino model>)
brep_8 = Brep(<brep referenced from the Rhino model>)
brep_9 = Brep(<brep referenced from the Rhino model>)
brep_10 = Brep(<brep referenced from the Rhino model>)
number_slider_16 = Slider(0.4, range=0..1)
surfaces_15 = Surfaces(SurfaceData_Branch0_Path="{0}")
brep_11 = Brep(<brep referenced from the Rhino model>)
brep_12 = Brep(<brep referenced from the Rhino model>)
brep_13 = Brep(<brep referenced from the Rhino model>)
brep_14 = Brep(<brep referenced from the Rhino model>)
negative_12 = Negative(Value=multiplication_5)
curvesdomain_12 = CurvesDomain(CurveData_Branch0_Path="{0}", CurveData_Branch0_Item0_EdgeIndex=-1, CurveData_Branch0_Item1_EdgeIndex=-1)
surfaces_16 = Surfaces(SurfaceData_Branch0_Path="{0}")
surfaces_17 = Surfaces(SurfaceData_Branch0_Path="{0}")
surfaces_18 = Surfaces(SurfaceData_Branch0_Path="{0}")
surfaces_19 = Surfaces(SurfaceData_Branch0_Path="{0}")
number_slider_17 = Slider(0, range=0..100)
number_slider_18 = Slider(1, range=0..1)
surfaces_20 = Surfaces(SurfaceData_Branch0_Path="{0}")
negative_13 = Negative(Value=number_slider_7)
brep_15 = Brep(<brep referenced from the Rhino model>)
brep_16 = Brep(<brep referenced from the Rhino model>)

c50混凝土泊松比_2 = Slider(0.3, range=0..1)
c50混凝土密度_2 = Slider(2251, range=0..10000)
c50混凝土弹性模量_2 = Slider(3.45, range=0..10)
multiplication_8 = Multiplication(A=c50混凝土弹性模量_2, B=Slider(10000, range=0..10000))
material = Material(Density=c50混凝土密度_2, Elasticity=multiplication_8, Poisson=c50混凝土泊松比_2, Mat=999)

brep_17 = Brep(<brep referenced from the Rhino model>)
brep_18 = Brep(<brep referenced from the Rhino model>)
c50混凝土密度_3 = Slider(2251, range=0..10000)
c50混凝土弹性模量_3 = Slider(3.45, range=0..10)
c50混凝土泊松比_3 = Slider(0.3, range=0..1)
curvesdomain_13 = CurvesDomain(CurveData_Branch0_Path="{0}", CurveData_Branch0_Item0_EdgeIndex=-1)
curvesdomain_14 = CurvesDomain(CurveData_Branch0_Path="{0}", CurveData_Branch0_Item0_EdgeIndex=-1)
curvesdomain_15 = CurvesDomain(CurveData_Branch0_Path="{0}", CurveData_Branch0_Item0_EdgeIndex=-1)

panel = Panel("Case1")

surfaces_21 = Surfaces(SurfaceData_Branch0_Path="{0}")
surfaces_22 = Surfaces(SurfaceData_Branch0_Path="{0}")
surfaces_23 = Surfaces(SurfaceData_Branch0_Path="{0}")
pointsdomain_3 = PointsDomain(pointsData_Branch0_Path="{0}", pointsData_Branch0_Item0_Coordinate=Point(-33046.18617, -75652.92253, 381.6101255))
curvesdomain_16 = CurvesDomain(CurveData_Branch0_Path="{0}", CurveData_Branch0_Item0_EdgeIndex=-1)
curvesdomain_17 = CurvesDomain(CurveData_Branch0_Path="{0}", CurveData_Branch0_Item0_EdgeIndex=-1)
pointsdomain_4 = PointsDomain(
    pointsData_Branch0_Path="{0}",
    pointsData_Branch0_Item0_Coordinate=Point(1030.608553, 1179.664518, 500),
    pointsData_Branch0_Item1_Coordinate=Point(1018.939496, 1143.1828, 500),
    pointsData_Branch0_Item2_Coordinate=Point(1061.550143, 1169.787655, 500),
    pointsData_Branch0_Item3_Coordinate=Point(1069.709086, 1112.666959, 450),
    pointsData_Branch0_Item4_Coordinate=Point(1064.355659, 1103.815564, 400),
    pointsData_Branch0_Item5_Coordinate=Point(1058.128704, 1098.913803, 350),
    pointsData_Branch0_Item6_Coordinate=Point(1050.87686, 1098.255538, 300),
    pointsData_Branch0_Item7_Coordinate=Point(1042.410493, 1102.246343, 250),
    pointsData_Branch0_Item8_Coordinate=Point(1032.486957, 1111.466269, 200),
    pointsData_Branch0_Item9_Coordinate=Point(1020.78771, 1126.789336, 150),
    pointsData_Branch0_Item10_Coordinate=Point(1006.881041, 1149.640033, 100),
    pointsData_Branch0_Item11_Coordinate=Point(990.1575171, 1182.65244, 50),
    pointsData_Branch0_Item12_Coordinate=Point(979.8047197, 1206.185326, 23.36748552),
    pointsData_Branch0_Item13_Coordinate=Point(1088.976705, 1225.973458, 23.36748552),
    pointsData_Branch0_Item14_Coordinate=Point(1069.942813, 1218.371301, 50),
    pointsData_Branch0_Item15_Coordinate=Point(1042.044718, 1201.719567, 100),
    pointsData_Branch0_Item16_Coordinate=Point(1022.10018, 1182.260151, 150),
    pointsData_Branch0_Item17_Coordinate=Point(1008.369928, 1162.46428, 200),
    pointsData_Branch0_Item18_Coordinate=Point(999.7320949, 1146.397956, 250),
    pointsData_Branch0_Item19_Coordinate=Point(995.4305334, 1135.737347, 300),
    pointsData_Branch0_Item20_Coordinate=Point(994.9493836, 1129.596069, 350),
    pointsData_Branch0_Item21_Coordinate=Point(997.9151662, 1126.684103, 399.627982),
    pointsData_Branch0_Item22_Coordinate=Point(1004.245676, 1125.999263, 450),
    pointsData_Branch0_Item23_Coordinate=Point(1024.683475, 1186.975989, 450),
    pointsData_Branch0_Item24_Coordinate=Point(1021.260402, 1192.332692, 400),
    pointsData_Branch0_Item25_Coordinate=Point(1021.080628, 1195.410017, 350),
    pointsData_Branch0_Item26_Coordinate=Point(1025.045415, 1195.794022, 300),
    pointsData_Branch0_Item27_Coordinate=Point(1033.996587, 1192.94984, 250),
    pointsData_Branch0_Item28_Coordinate=Point(1048.102573, 1186.181833, 200)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)
curvesdomain_18 = CurvesDomain(CurveData_Branch0_Path="{0}", CurveData_Branch0_Item0_EdgeIndex=-1)
curvesdomain_19 = CurvesDomain(CurveData_Branch0_Path="{0}", CurveData_Branch0_Item0_EdgeIndex=-1)
curvesdomain_20 = CurvesDomain(CurveData_Branch0_Path="{0}", CurveData_Branch0_Item0_EdgeIndex=-1)
surfaces_24 = Surfaces(SurfaceData_Branch0_Path="{0}")

negative_14 = Negative(Value=Slider(2.03, range=0..100))
load3d_5 = Load3D(Domain=surfaces_24, Fx=0, Fy=0, Fz=negative_14)

pointsdomain_5 = PointsDomain(pointsData_Branch0_Path="{0}", pointsData_Branch0_Item0_Coordinate=Point(-33046.18617, -75652.92253, 381.6101255))
pointsdomain_6 = PointsDomain(
    pointsData_Branch0_Path="{0}",
    pointsData_Branch0_Item0_Coordinate=Point(1030.608553, 1179.664518, 500),
    pointsData_Branch0_Item1_Coordinate=Point(1018.939496, 1143.1828, 500),
    pointsData_Branch0_Item2_Coordinate=Point(1061.550143, 1169.787655, 500),
    pointsData_Branch0_Item3_Coordinate=Point(1069.709086, 1112.666959, 450),
    pointsData_Branch0_Item4_Coordinate=Point(1064.355659, 1103.815564, 400),
    pointsData_Branch0_Item5_Coordinate=Point(1058.128704, 1098.913803, 350),
    pointsData_Branch0_Item6_Coordinate=Point(1050.87686, 1098.255538, 300),
    pointsData_Branch0_Item7_Coordinate=Point(1042.410493, 1102.246343, 250),
    pointsData_Branch0_Item8_Coordinate=Point(1032.486957, 1111.466269, 200),
    pointsData_Branch0_Item9_Coordinate=Point(1020.78771, 1126.789336, 150),
    pointsData_Branch0_Item10_Coordinate=Point(1006.881041, 1149.640033, 100),
    pointsData_Branch0_Item11_Coordinate=Point(990.1575171, 1182.65244, 50),
    pointsData_Branch0_Item12_Coordinate=Point(979.8047197, 1206.185326, 23.36748552),
    pointsData_Branch0_Item13_Coordinate=Point(1088.976705, 1225.973458, 23.36748552),
    pointsData_Branch0_Item14_Coordinate=Point(1069.942813, 1218.371301, 50),
    pointsData_Branch0_Item15_Coordinate=Point(1042.044718, 1201.719567, 100),
    pointsData_Branch0_Item16_Coordinate=Point(1022.10018, 1182.260151, 150),
    pointsData_Branch0_Item17_Coordinate=Point(1008.369928, 1162.46428, 200),
    pointsData_Branch0_Item18_Coordinate=Point(999.7320949, 1146.397956, 250),
    pointsData_Branch0_Item19_Coordinate=Point(995.4305334, 1135.737347, 300),
    pointsData_Branch0_Item20_Coordinate=Point(994.9493836, 1129.596069, 350),
    pointsData_Branch0_Item21_Coordinate=Point(997.9151662, 1126.684103, 399.627982),
    pointsData_Branch0_Item22_Coordinate=Point(1004.245676, 1125.999263, 450),
    pointsData_Branch0_Item23_Coordinate=Point(1024.683475, 1186.975989, 450),
    pointsData_Branch0_Item24_Coordinate=Point(1021.260402, 1192.332692, 400),
    pointsData_Branch0_Item25_Coordinate=Point(1021.080628, 1195.410017, 350),
    pointsData_Branch0_Item26_Coordinate=Point(1025.045415, 1195.794022, 300),
    pointsData_Branch0_Item27_Coordinate=Point(1033.996587, 1192.94984, 250),
    pointsData_Branch0_Item28_Coordinate=Point(1048.102573, 1186.181833, 200)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)
negative_15 = Negative(Value=Slider(2.03, range=0..100))
multiplication_9 = Multiplication(A=c50混凝土弹性模量, B=Slider(10000, range=0..10000))
surfaces_25 = Surfaces(SurfaceData_Branch0_Path="{0}")
negative_16 = Negative(Value=number_slider_8)
surfaces_26 = Surfaces(SurfaceData_Branch0_Path="{0}")
surfaces_27 = Surfaces(SurfaceData_Branch0_Path="{0}")
c50混凝土密度_4 = Slider(2251, range=0..10000)
c50混凝土弹性模量_4 = Slider(3.45, range=0..10)
c50混凝土泊松比_4 = Slider(0.3, range=0..1)

number_slider_19 = Slider(0, range=0..100)
support3d = Support3D(Domain=surfaces_6, Ux=number_slider_19, Uy=number_slider_19, Uz=number_slider_19, Tolerance=Slider(0.01, range=0..0.01))

brep_19 = Brep(<brep referenced from the Rhino model>)
brep_20 = Brep(<brep referenced from the Rhino model>)
brep_21 = Brep(<brep referenced from the Rhino model>)
brep_22 = Brep(<brep referenced from the Rhino model>)

number_slider_20 = Slider(0.4, range=0..1)
beso_optparameters = BESOOptParameters(Sensitivity=1, Vf=Slider(0.13, range=0..1), Ert=Slider(0.02, range=0..0.1), Rmin=Slider(6, range=0..100), Steps=300)

curvesdomain_21 = CurvesDomain(CurveData_Branch0_Path="{0}", CurveData_Branch0_Item0_EdgeIndex=-1)
number_slider_21 = Slider(0.4, range=0..1)
curvesdomain_22 = CurvesDomain(CurveData_Branch0_Path="{0}", CurveData_Branch0_Item0_EdgeIndex=-1)
curvesdomain_23 = CurvesDomain(CurveData_Branch0_Path="{0}", CurveData_Branch0_Item0_EdgeIndex=-1)
curvesdomain_24 = CurvesDomain(CurveData_Branch0_Path="{0}", CurveData_Branch0_Item0_EdgeIndex=-1, CurveData_Branch0_Item1_EdgeIndex=-1)

domain3d = Domain3D(Geo=curvesdomain_24, Tolerance=Slider(3, range=0..10))
symmetry = Symmetry(Symmetry=surfaces_15)

curvesdomain_25 = CurvesDomain(CurveData_Branch0_Path="{0}", CurveData_Branch0_Item0_EdgeIndex=-1)
curvesdomain_26 = CurvesDomain(CurveData_Branch0_Path="{0}", CurveData_Branch0_Item0_EdgeIndex=-1)
curvesdomain_27 = CurvesDomain(CurveData_Branch0_Path="{0}", CurveData_Branch0_Item0_EdgeIndex=-1)
pointsdomain_7 = PointsDomain(pointsData_Branch0_Path="{0}", pointsData_Branch0_Item0_Coordinate=Point(-33046.18617, -75652.92253, 381.6101255))
pointsdomain_8 = PointsDomain(
    pointsData_Branch0_Path="{0}",
    pointsData_Branch0_Item0_Coordinate=Point(1030.608553, 1179.664518, 500),
    pointsData_Branch0_Item1_Coordinate=Point(1018.939496, 1143.1828, 500),
    pointsData_Branch0_Item2_Coordinate=Point(1061.550143, 1169.787655, 500),
    pointsData_Branch0_Item3_Coordinate=Point(1069.709086, 1112.666959, 450),
    pointsData_Branch0_Item4_Coordinate=Point(1064.355659, 1103.815564, 400),
    pointsData_Branch0_Item5_Coordinate=Point(1058.128704, 1098.913803, 350),
    pointsData_Branch0_Item6_Coordinate=Point(1050.87686, 1098.255538, 300),
    pointsData_Branch0_Item7_Coordinate=Point(1042.410493, 1102.246343, 250),
    pointsData_Branch0_Item8_Coordinate=Point(1032.486957, 1111.466269, 200),
    pointsData_Branch0_Item9_Coordinate=Point(1020.78771, 1126.789336, 150),
    pointsData_Branch0_Item10_Coordinate=Point(1006.881041, 1149.640033, 100),
    pointsData_Branch0_Item11_Coordinate=Point(990.1575171, 1182.65244, 50),
    pointsData_Branch0_Item12_Coordinate=Point(979.8047197, 1206.185326, 23.36748552),
    pointsData_Branch0_Item13_Coordinate=Point(1088.976705, 1225.973458, 23.36748552),
    pointsData_Branch0_Item14_Coordinate=Point(1069.942813, 1218.371301, 50),
    pointsData_Branch0_Item15_Coordinate=Point(1042.044718, 1201.719567, 100),
    pointsData_Branch0_Item16_Coordinate=Point(1022.10018, 1182.260151, 150),
    pointsData_Branch0_Item17_Coordinate=Point(1008.369928, 1162.46428, 200),
    pointsData_Branch0_Item18_Coordinate=Point(999.7320949, 1146.397956, 250),
    pointsData_Branch0_Item19_Coordinate=Point(995.4305334, 1135.737347, 300),
    pointsData_Branch0_Item20_Coordinate=Point(994.9493836, 1129.596069, 350),
    pointsData_Branch0_Item21_Coordinate=Point(997.9151662, 1126.684103, 399.627982),
    pointsData_Branch0_Item22_Coordinate=Point(1004.245676, 1125.999263, 450),
    pointsData_Branch0_Item23_Coordinate=Point(1024.683475, 1186.975989, 450),
    pointsData_Branch0_Item24_Coordinate=Point(1021.260402, 1192.332692, 400),
    pointsData_Branch0_Item25_Coordinate=Point(1021.080628, 1195.410017, 350),
    pointsData_Branch0_Item26_Coordinate=Point(1025.045415, 1195.794022, 300),
    pointsData_Branch0_Item27_Coordinate=Point(1033.996587, 1192.94984, 250),
    pointsData_Branch0_Item28_Coordinate=Point(1048.102573, 1186.181833, 200)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)
curvesdomain_28 = CurvesDomain(CurveData_Branch0_Path="{0}", CurveData_Branch0_Item0_EdgeIndex=-1, CurveData_Branch0_Item1_EdgeIndex=-1)
negative_17 = Negative(Value=multiplication_6)
surfaces_28 = Surfaces(SurfaceData_Branch0_Path="{0}")
panel_2 = Panel("Case2")
load3d_6 = Load3D(Domain=[surfaces_12, surfaces_11], Fx=0, Fy=0, Fz=negative_8)
surfaces_29 = Surfaces(SurfaceData_Branch0_Path="{0}")
curvesdomain_29 = CurvesDomain(CurveData_Branch0_Path="{0}", CurveData_Branch0_Item0_EdgeIndex=-1)
domain3d_2 = Domain3D(Geo=curvesdomain_12, Tolerance=Slider(3, range=0..10))
amebamesh3d = AmebaMesh3D(FilePath="E:\Ameba\2020-10-9Highrise", ProjectName="Case5", ClosedBrep=brep_5, Size=Slider(4, range=0..10), algorithm3=1)
load3d_7 = Load3D(Domain=[curvesdomain_4, curvesdomain], Fx=negative_2, Fy=multiplication, Fz=0)
support3d_2 = Support3D(Domain=surfaces, Ux=number_slider_9, Uy=number_slider_9, Uz=number_slider_9, Tolerance=Slider(0.01, range=0..0.01))
beso_optparameters_2 = BESOOptParameters(Sensitivity=1, Vf=Slider(0.13, range=0..1), Ert=Slider(0.02, range=0..0.1), Rmin=Slider(6, range=0..100), Steps=300)
load3d_8 = Load3D(Domain=curvesdomain_5, Fx=negative_3, Fy=0, Fz=0)
load3d_9 = Load3D(Domain=curvesdomain_7, Fx=0, Fy=number_slider_4, Fz=0)
load3d_10 = Load3D(Domain=curvesdomain_6, Fx=0, Fy=number_slider_4, Fz=0)
c50混凝土密度_5 = Slider(2251, range=0..10000)
c50混凝土弹性模量_5 = Slider(3.45, range=0..10)
c50混凝土泊松比_5 = Slider(0.3, range=0..1)
load3d_11 = Load3D(Domain=curvesdomain_3, Fx=negative_2, Fy=multiplication, Fz=0)
symmetry_2 = Symmetry(Symmetry=surfaces_4)
load3d_12 = Load3D(Domain=curvesdomain_2, Fx=negative_2, Fy=multiplication, Fz=0)
number_slider_22 = Slider(0.4, range=0..1)
curvesdomain_30 = CurvesDomain(CurveData_Branch0_Path="{0}", CurveData_Branch0_Item0_EdgeIndex=-1)
curvesdomain_31 = CurvesDomain(CurveData_Branch0_Path="{0}", CurveData_Branch0_Item0_EdgeIndex=-1)
curvesdomain_32 = CurvesDomain(CurveData_Branch0_Path="{0}", CurveData_Branch0_Item0_EdgeIndex=-1)
curvesdomain_33 = CurvesDomain(CurveData_Branch0_Path="{0}", CurveData_Branch0_Item0_EdgeIndex=-1, CurveData_Branch0_Item1_EdgeIndex=-1)
curvesdomain_34 = CurvesDomain(CurveData_Branch0_Path="{0}", CurveData_Branch0_Item0_EdgeIndex=-1)
curvesdomain_35 = CurvesDomain(CurveData_Branch0_Path="{0}", CurveData_Branch0_Item0_EdgeIndex=-1)
curvesdomain_36 = CurvesDomain(CurveData_Branch0_Path="{0}", CurveData_Branch0_Item0_EdgeIndex=-1)
material_2 = Material(Density=c50混凝土密度, Elasticity=multiplication_9, Poisson=c50混凝土泊松比, Mat=999)
pointsdomain_9 = PointsDomain(pointsData_Branch0_Path="{0}", pointsData_Branch0_Item0_Coordinate=Point(-33046.18617, -75652.92253, 381.6101255))
panel_3 = Panel("Case3")
pointsdomain_10 = PointsDomain(
    pointsData_Branch0_Path="{0}",
    pointsData_Branch0_Item0_Coordinate=Point(1030.608553, 1179.664518, 500),
    pointsData_Branch0_Item1_Coordinate=Point(1018.939496, 1143.1828, 500),
    pointsData_Branch0_Item2_Coordinate=Point(1061.550143, 1169.787655, 500),
    pointsData_Branch0_Item3_Coordinate=Point(1069.709086, 1112.666959, 450),
    pointsData_Branch0_Item4_Coordinate=Point(1064.355659, 1103.815564, 400),
    pointsData_Branch0_Item5_Coordinate=Point(1058.128704, 1098.913803, 350),
    pointsData_Branch0_Item6_Coordinate=Point(1050.87686, 1098.255538, 300),
    pointsData_Branch0_Item7_Coordinate=Point(1042.410493, 1102.246343, 250),
    pointsData_Branch0_Item8_Coordinate=Point(1032.486957, 1111.466269, 200),
    pointsData_Branch0_Item9_Coordinate=Point(1020.78771, 1126.789336, 150),
    pointsData_Branch0_Item10_Coordinate=Point(1006.881041, 1149.640033, 100),
    pointsData_Branch0_Item11_Coordinate=Point(990.1575171, 1182.65244, 50),
    pointsData_Branch0_Item12_Coordinate=Point(979.8047197, 1206.185326, 23.36748552),
    pointsData_Branch0_Item13_Coordinate=Point(1088.976705, 1225.973458, 23.36748552),
    pointsData_Branch0_Item14_Coordinate=Point(1069.942813, 1218.371301, 50),
    pointsData_Branch0_Item15_Coordinate=Point(1042.044718, 1201.719567, 100),
    pointsData_Branch0_Item16_Coordinate=Point(1022.10018, 1182.260151, 150),
    pointsData_Branch0_Item17_Coordinate=Point(1008.369928, 1162.46428, 200),
    pointsData_Branch0_Item18_Coordinate=Point(999.7320949, 1146.397956, 250),
    pointsData_Branch0_Item19_Coordinate=Point(995.4305334, 1135.737347, 300),
    pointsData_Branch0_Item20_Coordinate=Point(994.9493836, 1129.596069, 350),
    pointsData_Branch0_Item21_Coordinate=Point(997.9151662, 1126.684103, 399.627982),
    pointsData_Branch0_Item22_Coordinate=Point(1004.245676, 1125.999263, 450),
    pointsData_Branch0_Item23_Coordinate=Point(1024.683475, 1186.975989, 450),
    pointsData_Branch0_Item24_Coordinate=Point(1021.260402, 1192.332692, 400),
    pointsData_Branch0_Item25_Coordinate=Point(1021.080628, 1195.410017, 350),
    pointsData_Branch0_Item26_Coordinate=Point(1025.045415, 1195.794022, 300),
    pointsData_Branch0_Item27_Coordinate=Point(1033.996587, 1192.94984, 250),
    pointsData_Branch0_Item28_Coordinate=Point(1048.102573, 1186.181833, 200)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)
negative_18 = Negative(Value=multiplication_7)
surfaces_30 = Surfaces(SurfaceData_Branch0_Path="{0}")
surfaces_31 = Surfaces(SurfaceData_Branch0_Path="{0}")
multiplication_10 = Multiplication(A=c50混凝土弹性模量_3, B=Slider(10000, range=0..10000))
number_slider_23 = Slider(2.5, range=0..10)
number_slider_24 = Slider(2, range=0..10)
number_slider_25 = Slider(0.4, range=0..1)
curvesdomain_37 = CurvesDomain(CurveData_Branch0_Path="{0}", CurveData_Branch0_Item0_EdgeIndex=-1, CurveData_Branch0_Item1_EdgeIndex=-1)
panel_4 = Panel("Case4")
multiplication_11 = Multiplication(A=c50混凝土弹性模量_4, B=Slider(10000, range=0..10000))
domain3d_3 = Domain3D(Geo=curvesdomain_28, Tolerance=Slider(3, range=0..10))
amebamesh3d_2 = AmebaMesh3D(FilePath="E:\Ameba\2020-10-9Highrise", ClosedBrep=brep_10, Size=Slider(4, range=0..10), algorithm3=1)
surfaces_32 = Surfaces(SurfaceData_Branch0_Path="{0}")
load3d_13 = Load3D(Domain=curvesdomain_15, Fx=negative_4, Fy=multiplication_2, Fz=0)
support3d_3 = Support3D(Domain=surfaces_9, Ux=number_slider_13, Uy=number_slider_13, Uz=number_slider_13, Tolerance=Slider(0.01, range=0..0.01))
load3d_14 = Load3D(Domain=curvesdomain_13, Fx=negative_4, Fy=multiplication_2, Fz=0)
beso_optparameters_3 = BESOOptParameters(Sensitivity=1, Vf=Slider(0.13, range=0..1), Ert=Slider(0.02, range=0..0.1), Rmin=Slider(6, range=0..100), Steps=300)
load3d_15 = Load3D(Domain=surfaces_6, Fx=0, Fy=0, Fz=negative_15)
amebamesh3d_3 = AmebaMesh3D(FilePath="E:\Ameba\2020-10-9Highrise", ClosedBrep=brep_11, Size=Slider(4, range=0..10), algorithm3=1)
load3d_16 = Load3D(Domain=curvesdomain_18, Fx=negative_10, Fy=0, Fz=0)
load3d_17 = Load3D(Domain=curvesdomain_20, Fx=0, Fy=number_slider_6, Fz=0)
load3d_18 = Load3D(Domain=curvesdomain_17, Fx=negative_5, Fy=multiplication_3, Fz=0)
load3d_19 = Load3D(Domain=curvesdomain_19, Fx=0, Fy=number_slider_6, Fz=0)
load3d_20 = Load3D(Domain=curvesdomain_16, Fx=negative_5, Fy=multiplication_3, Fz=0)
symmetry_3 = Symmetry(Symmetry=surfaces_14)
load3d_21 = Load3D(Domain=curvesdomain_14, Fx=negative_5, Fy=multiplication_3, Fz=0)
material_3 = Material(Density=c50混凝土密度_3, Elasticity=multiplication_10, Poisson=c50混凝土泊松比_3, Mat=999)
multiplication_12 = Multiplication(A=c50混凝土弹性模量_5, B=Slider(10000, range=0..10000))
domain3d_4 = Domain3D(Geo=curvesdomain_33, Tolerance=Slider(3, range=0..10))
support3d_4 = Support3D(Domain=surfaces_25, Ux=number_slider_14, Uy=number_slider_14, Uz=number_slider_14, Tolerance=Slider(0.01, range=0..0.01))
beso_optparameters_4 = BESOOptParameters(Sensitivity=1, Vf=Slider(0.13, range=0..1), Ert=Slider(0.02, range=0..0.1), Rmin=Slider(6, range=0..100), Steps=300)
amebamesh3d_4 = AmebaMesh3D(FilePath="E:\Ameba\2020-10-9Highrise", ClosedBrep=brep_18, Size=Slider(4, range=0..10), algorithm3=1)
load3d_22 = Load3D(Domain=curvesdomain_25, Fx=negative_6, Fy=multiplication_4, Fz=0)
load3d_23 = Load3D(Domain=curvesdomain_26, Fx=negative_6, Fy=negative_6, Fz=0)
load3d_24 = Load3D(Domain=surfaces_9, Fx=0, Fy=0, Fz=negative_17)
load3d_25 = Load3D(Domain=curvesdomain_22, Fx=negative_6, Fy=multiplication_4, Fz=0)
load3d_26 = Load3D(Domain=curvesdomain_23, Fx=multiplication_4, Fy=multiplication_4, Fz=0)
load3d_27 = Load3D(Domain=curvesdomain_27, Fx=multiplication_4, Fy=negative_6, Fz=0)
symmetry_4 = Symmetry(Symmetry=surfaces_20)
load3d_28 = Load3D(Domain=curvesdomain_21, Fx=negative_6, Fy=multiplication_4, Fz=0)
material_4 = Material(Density=c50混凝土密度_4, Elasticity=multiplication_11, Poisson=c50混凝土泊松比_4, Mat=999)
domain3d_5 = Domain3D(Geo=curvesdomain_37, Tolerance=Slider(3, range=0..10))
preprocessing = PreProcessing(
    AmebaMeshFile=amebamesh3d,
    Supports=support3d_2,
    Loads=[load3d_7, load3d_6],
    Gravity=Vector(0, 0, 0),
    SubDesigndomains="[]",
    Nondesigndomains="[]",
    Symmetry=symmetry_2,
    Parameters=beso_optparameters_2,
    Material=material_2)
support3d_5 = Support3D(Domain=surfaces_32, Ux=number_slider_17, Uy=number_slider_17, Uz=number_slider_17, Tolerance=Slider(0.01, range=0..0.01))
beso_optparameters_5 = BESOOptParameters(Sensitivity=1, Vf=Slider(0.15, range=0..1), Ert=Slider(0.02, range=0..0.1), Rmin=Slider(6, range=0..100), Steps=300)
amebamesh3d_5 = AmebaMesh3D(FilePath="E:\Ameba\2020-10-9Highrise", ClosedBrep=brep_20, Size=Slider(4, range=0..10), algorithm3=1)
load3d_29 = Load3D(Domain=curvesdomain_34, Fx=negative_11, Fy=multiplication_5, Fz=0)
load3d_30 = Load3D(Domain=curvesdomain_35, Fx=negative_11, Fy=negative_11, Fz=0)
load3d_31 = Load3D(Domain=surfaces_25, Fx=0, Fy=0, Fz=negative_18)
load3d_32 = Load3D(Domain=curvesdomain_31, Fx=negative_11, Fy=multiplication_5, Fz=0)
load3d_33 = Load3D(Domain=curvesdomain_29, Fx=multiplication_5, Fy=multiplication_5, Fz=0)
load3d_34 = Load3D(Domain=curvesdomain_36, Fx=multiplication_5, Fy=negative_11, Fz=0)
symmetry_5 = Symmetry(Symmetry=surfaces_31)
load3d_35 = Load3D(Domain=curvesdomain_30, Fx=negative_11, Fy=multiplication_5, Fz=0)
material_5 = Material(Density=c50混凝土密度_5, Elasticity=multiplication_12, Poisson=c50混凝土泊松比_5, Mat=999)
number_slider_26 = Slider(121, range=0..1000)
number_slider_27 = Slider(96, range=0..100)
preprocessing_2 = PreProcessing(
    AmebaMeshFile=amebamesh3d_2,
    Supports=support3d,
    Loads=[load3d, load3d_5],
    Gravity=Vector(0, 0, 0),
    SubDesigndomains="[]",
    Nondesigndomains="[]",
    Symmetry=symmetry,
    Parameters=beso_optparameters,
    Material=material)
preprocessing_3 = PreProcessing(
    AmebaMeshFile=amebamesh3d_3,
    Supports=support3d_3,
    Loads=[load3d_15, load3d_18],
    Gravity=Vector(0, 0, 0),
    SubDesigndomains="[]",
    Nondesigndomains="[]",
    Symmetry=symmetry_3,
    Parameters=beso_optparameters_3,
    Material=material_3)
number_slider_28 = Slider(121, range=0..1000)
preprocessing_4 = PreProcessing(
    AmebaMeshFile=amebamesh3d_4,
    Supports=support3d_4,
    Loads=[load3d_24, load3d_26, load3d_22, load3d_23, load3d_27],
    Gravity=Vector(0, 0, 0),
    SubDesigndomains="[]",
    Nondesigndomains="[]",
    Symmetry=symmetry_4,
    Parameters=beso_optparameters_4,
    Material=material_4)
number_slider_29 = Slider(121, range=0..1000)
number_slider_30 = Slider(96, range=0..100)
number_slider_31 = Slider(119, range=0..1000)
number_slider_32 = Slider(110, range=0..1000)
login = Login()
number_slider_33 = Slider(96, range=0..100)
number_slider_34 = Slider(121, range=0..1000)
preprocessing_5 = PreProcessing(
    AmebaMeshFile=amebamesh3d_5,
    Supports=support3d_5,
    Loads=[load3d_31, load3d_33],
    Gravity=Vector(0, 0, 0),
    SubDesigndomains="[]",
    Nondesigndomains="[]",
    Symmetry=symmetry_5,
    Parameters=beso_optparameters_5,
    Material=material_5)
number_slider_35 = Slider(96, range=0..100)
number_slider_36 = Slider(121, range=0..1000)
solver = Solver(MeshFile=preprocessing)
number_slider_37 = Slider(96, range=0..100)
display = Display(MeshFile=preprocessing, Step=Slider(91, range=0..1000), Scale=0, Linear=False, displayColor=0)  # -> Mesh, Value
number_slider_38 = Slider(119, range=0..1000)
number_slider_39 = Slider(110, range=0..1000)
login_2 = Login()
number_slider_40 = Slider(119, range=0..1000)
number_slider_41 = Slider(110, range=0..1000)
login_3 = Login()
number_slider_42 = Slider(119, range=0..1000)
number_slider_43 = Slider(110, range=0..1000)
login_4 = Login()
solver_2 = Solver(MeshFile=preprocessing_2)
solver_3 = Solver(MeshFile=preprocessing_3)
display_2 = Display(MeshFile=preprocessing_2, Step=Slider(97, range=0..1000), Scale=0, Linear=False, displayColor=0)  # -> Mesh, Value
number_slider_44 = Slider(119, range=0..1000)
number_slider_45 = Slider(110, range=0..1000)
login_5 = Login()
display_3 = Display(MeshFile=preprocessing_3, Step=Slider(160, range=0..1000), Scale=0, Linear=False, displayColor=0)  # -> Mesh, Value
number_slider_46 = Slider(1, range=0..1)
number_slider_47 = Slider(1.7, range=0..10)
solver_4 = Solver(MeshFile=preprocessing_4)
display_4 = Display(MeshFile=preprocessing_4, Step=Slider(46, range=0..1000), Scale=0, Linear=False, displayColor=0)  # -> Mesh, Value
solver_5 = Solver(MeshFile=preprocessing_5)
geometry = Geometry(<brep referenced from the Rhino model>)
display_5 = Display(MeshFile=preprocessing_5, Step=Slider(78, range=0..1000), Scale=0, Linear=False, displayColor=0)  # -> Mesh, Value
number_slider_48 = Slider(1, range=0..1)
number_slider_49 = Slider(1.7, range=0..10)
number_slider_50 = Slider(1.7, range=0..10)
number_slider_51 = Slider(1, range=0..1)
renderdisplay = RenderDisplay(IsWire=True)
number_slider_52 = Slider(1, range=0..1)
number_slider_53 = Slider(1.7, range=0..10)
geometry_2 = Geometry(<brep referenced from the Rhino model>)
geometry_3 = Geometry(<brep referenced from the Rhino model>)
remesh = Remesh(Geometry=flatten(display.Mesh), Radius=1, Size=number_slider_47, Bandwidth=1, Iso=0.1, Adaptivity=0.1)
number_slider_54 = Slider(1, range=0..1)
number_slider_55 = Slider(1.7, range=0..10)
geometry_4 = Geometry(<brep referenced from the Rhino model>)
renderdisplay_2 = RenderDisplay(IsWire=True)
renderdisplay_3 = RenderDisplay(IsWire=True)
geometry_5 = Geometry(<brep referenced from the Rhino model>)
remesh_2 = Remesh(Geometry=flatten(display_2.Mesh), Radius=1, Size=number_slider_49, Bandwidth=1, Iso=0.1, Adaptivity=0.1)
renderdisplay_4 = RenderDisplay(IsWire=True)
remesh_3 = Remesh(Geometry=flatten(display_3.Mesh), Radius=1, Size=number_slider_50, Bandwidth=1, Iso=0.1, Adaptivity=0.1)
quadmesh = QuadMesh(
    FaceCount=Slider(1000, range=0..1000),
    Crease=Slider(90, range=0..100),
    Boundaries=Toggle(True),
    PullBack=Toggle(False),
    Algorithm=Toggle(True))
smooth = Smooth(Mesh=remesh, Level=Slider(2.1, range=0..10), Fixed=True)
remesh_4 = Remesh(Geometry=flatten(display_4.Mesh), Radius=1, Size=number_slider_53, Bandwidth=1, Iso=0.1, Adaptivity=0.1)
renderdisplay_5 = RenderDisplay(IsWire=True)
remesh_5 = Remesh(Geometry=flatten(display_5.Mesh), Radius=1, Size=number_slider_55, Bandwidth=1, Iso=0.1, Adaptivity=0.1)
quadmesh_2 = QuadMesh(
    FaceCount=Slider(1000, range=0..1000),
    Crease=Slider(90, range=0..100),
    Boundaries=Toggle(True),
    PullBack=Toggle(False),
    Algorithm=Toggle(True))
smooth_2 = Smooth(Mesh=remesh_2, Level=Slider(2.1, range=0..10), Fixed=True)
quadmesh_3 = QuadMesh(
    FaceCount=Slider(1000, range=0..1000),
    Crease=Slider(90, range=0..100),
    Boundaries=Toggle(True),
    PullBack=Toggle(False),
    Algorithm=Toggle(True))
smooth_3 = Smooth(Mesh=remesh_3, Level=Slider(2.1, range=0..10), Fixed=True)
remesh_6 = Remesh(Geometry=flatten(smooth), Radius=1, Size=number_slider_47, Bandwidth=1, Iso=0.1, Adaptivity=0.1)
quadmesh_4 = QuadMesh(
    FaceCount=Slider(1000, range=0..1000),
    Crease=Slider(90, range=0..100),
    Boundaries=Toggle(True),
    PullBack=Toggle(False),
    Algorithm=Toggle(True))
smooth_4 = Smooth(Mesh=remesh_4, Level=Slider(2.1, range=0..10), Fixed=True)
renderdisplay_6 = RenderDisplay(Geometry=smooth, IsWire=True)
quadmesh_5 = QuadMesh(
    FaceCount=Slider(1000, range=0..1000),
    Crease=Slider(90, range=0..100),
    Boundaries=Toggle(True),
    PullBack=Toggle(False),
    Algorithm=Toggle(True))
smooth_5 = Smooth(Mesh=remesh_5, Level=Slider(2.1, range=0..10), Fixed=True)
remesh_7 = Remesh(Geometry=flatten(smooth_2), Radius=1, Size=number_slider_49, Bandwidth=1, Iso=0.1, Adaptivity=0.1)
remesh_8 = Remesh(Geometry=flatten(smooth_3), Radius=1, Size=number_slider_50, Bandwidth=1, Iso=0.1, Adaptivity=0.1)
smooth_6 = Smooth(Mesh=remesh_6, Level=Slider(1, range=0..10), Fixed=True)
remesh_9 = Remesh(Geometry=flatten(smooth_4), Radius=1, Size=number_slider_53, Bandwidth=1, Iso=0.1, Adaptivity=0.1)
renderdisplay_7 = RenderDisplay(Geometry=smooth_2, IsWire=True)
renderdisplay_8 = RenderDisplay(Geometry=smooth_3, IsWire=True)
remesh_10 = Remesh(Geometry=flatten(smooth_5), Radius=1, Size=number_slider_55, Bandwidth=1, Iso=0.1, Adaptivity=0.1)
renderdisplay_9 = RenderDisplay(Geometry=smooth_4, IsWire=True)
smooth_7 = Smooth(Mesh=remesh_7, Level=Slider(1, range=0..10), Fixed=True)
smooth_8 = Smooth(Mesh=remesh_8, Level=Slider(1, range=0..10), Fixed=True)
renderdisplay_10 = RenderDisplay(Geometry=smooth_5, IsWire=True)
smooth_9 = Smooth(Mesh=remesh_9, Level=Slider(1, range=0..10), Fixed=True)
smooth_10 = Smooth(Mesh=remesh_10, Level=Slider(1, range=0..10), Fixed=True)
