# Grasshopper definition 11-8 Ameba.gh (Grasshopper 1.0.7)

# ----
# 原点
原点y = Slider(1150.985986, range=0..10000)
原点z = Slider(0, range=0..100)
原点x = Slider(1040.709086, range=0..10000)
construct_point = ConstructPoint(XCoordinate=原点x, YCoordinate=原点y, ZCoordinate=原点z)

# ----
# 角点位置
number_slider = Slider(73, range=0..100)

unit_x = UnitX(Factor=expr("-x", number_slider))
unit_y = UnitY(Factor=expr("-x", Slider(73, range=0..100)))
move = Move(Geometry=construct_point, Motion=unit_x)  # -> Geometry, Transform
move_2 = Move(Geometry=move.Geometry, Motion=unit_y)  # -> Geometry, Transform
unit_z = UnitZ(Factor=Slider(588, range=0..1000))
move_3 = Move(Geometry=move_2.Geometry, Motion=unit_z)  # -> Geometry, Transform
number_slider_2 = Slider(6, range=0..100)
line = Line(StartPoint=move_2.Geometry, EndPoint=move_3.Geometry)

# ----
# 形体控制
divide_curve = DivideCurve(Curve=line, Count=number_slider_2, Kinks=False)  # -> Points, Tangents, Parameters
construct_domain = ConstructDomain(DomainStart=Slider(0, range=0..100), DomainEnd=Slider(1, range=0..1))
construct_domain_2 = ConstructDomain(DomainStart=Slider(0, range=0..100), DomainEnd=Slider(1, range=0..1))
range = Range(Domain=construct_domain, Steps=number_slider_2)
range_2 = Range(Domain=construct_domain_2, Steps=number_slider_2)
number_slider_3 = Slider(100, range=0..100)
graph_mapper = GraphMapper(
    range,
    x0=0,
    x1=1,
    y0=0,
    y1=1,
    container_name="Bezier",
    cpx=[0, 0.1136050001, 0.5406441092, 1],
    cpy=[0, 0.4688154459, 0.6738785505, 0.4353487492])
graph_mapper_2 = GraphMapper(
    range_2,
    x0=0,
    x1=1,
    y0=0,
    y1=1,
    container_name="Bezier",
    cpx=[0, 0.1256439686, 0.5399003029, 1],
    cpy=[0, 0.456286788, 0.927333951, 0.7418249846])
construct_domain_3 = ConstructDomain(DomainStart=Slider(0, range=0..100), DomainEnd=Slider(121, range=0..1000))
bounds = Bounds(Numbers=graph_mapper)
construct_domain_4 = ConstructDomain(DomainStart=Slider(0, range=0..100), DomainEnd=Slider(98, range=0..1000))
bounds_2 = Bounds(Numbers=graph_mapper_2)
remap_numbers = RemapNumbers(Value=graph_mapper, Source=bounds, Target=construct_domain_3)  # -> Mapped, Clipped
remap_numbers_2 = RemapNumbers(Value=graph_mapper_2, Source=bounds_2, Target=construct_domain_4)  # -> Mapped, Clipped
unit_x_2 = UnitX(Factor=remap_numbers.Mapped)
unit_y_2 = UnitY(Factor=remap_numbers_2.Mapped)
move_4 = Move(Geometry=divide_curve.Points, Motion=unit_x_2)  # -> Geometry, Transform

move_5 = Move(Geometry=move_4.Geometry, Motion=unit_y_2)  # -> Geometry, Transform
interpolate = Interpolate(Vertices=move_5.Geometry, Degree=3, Periodic=False, KnotStyle=1)  # -> Curve, Length, Domain
rotate = Rotate(Geometry=interpolate.Curve, Angle=degrees(Slider(90, range=0..100)), Plane=construct_point)  # -> Geometry, Transform
rotate_2 = Rotate(Geometry=interpolate.Curve, Angle=degrees(Slider(180, range=0..1000)), Plane=construct_point)  # -> Geometry, Transform
rotate_3 = Rotate(Geometry=interpolate.Curve, Angle=degrees(Slider(270, range=0..1000)), Plane=construct_point)  # -> Geometry, Transform
curve = Curve(interpolate.Curve)
loft = Loft(
    Curves=[curve, rotate.Geometry],
    Options={Adjust=False, Closed=False, LoftEnds=0, LoftSimp=0, LoftType=0, Rebuild=10, Refit=0.01})
loft_2 = Loft(
    Curves=[rotate.Geometry, rotate_2.Geometry],
    Options={Adjust=False, Closed=False, LoftEnds=0, LoftSimp=0, LoftType=0, Rebuild=10, Refit=0.01})
loft_3 = Loft(
    Curves=[rotate_2.Geometry, rotate_3.Geometry],
    Options={Adjust=False, Closed=False, LoftEnds=0, LoftSimp=0, LoftType=0, Rebuild=10, Refit=0.01})
loft_4 = Loft(
    Curves=[rotate_3.Geometry, curve],
    Options={Adjust=False, Closed=False, LoftEnds=0, LoftSimp=0, LoftType=0, Rebuild=10, Refit=0.01})
brep_join = BrepJoin(Breps=[loft, loft_2, loft_3, loft_4])  # -> Breps, Closed

# ----
# brep 体块
cap_holes = CapHoles(Brep=brep_join.Breps)

curve_2 = Curve(curve)
curve_3 = Curve(rotate_2.Geometry)
curve_4 = Curve(rotate.Geometry)
curve_5 = Curve(rotate_3.Geometry)
number_slider_4 = Slider(50, range=0..100)
number_slider_5 = Slider(5, range=0..10)
number_slider_6 = Slider(32, range=0..100)
挤出 = Slider(10.1, range=0..100)
divide_curve_2 = DivideCurve(Curve=curve_5, Count=number_slider_4, Kinks=False)  # -> Points, Tangents, Parameters
divide_curve_3 = DivideCurve(Curve=curve_3, Count=number_slider_4, Kinks=False)  # -> Points, Tangents, Parameters
divide_curve_4 = DivideCurve(Curve=curve_3, Count=number_slider_4, Kinks=False)  # -> Points, Tangents, Parameters
divide_curve_5 = DivideCurve(Curve=curve_4, Count=number_slider_4, Kinks=False)  # -> Points, Tangents, Parameters
divide_curve_6 = DivideCurve(Curve=curve_2, Count=number_slider_4, Kinks=False)  # -> Points, Tangents, Parameters
divide_curve_7 = DivideCurve(Curve=curve_5, Count=number_slider_4, Kinks=False)  # -> Points, Tangents, Parameters
divide_curve_8 = DivideCurve(Curve=curve_4, Count=number_slider_4, Kinks=False)  # -> Points, Tangents, Parameters
divide_curve_9 = DivideCurve(Curve=curve_2, Count=number_slider_4, Kinks=False)  # -> Points, Tangents, Parameters
divide_curve_10 = DivideCurve(Curve=curve_4, Count=number_slider_4, Kinks=False)  # -> Points, Tangents, Parameters
divide_curve_11 = DivideCurve(Curve=curve_3, Count=number_slider_4, Kinks=False)  # -> Points, Tangents, Parameters
divide_curve_12 = DivideCurve(Curve=curve_2, Count=number_slider_4, Kinks=False)  # -> Points, Tangents, Parameters
divide_curve_13 = DivideCurve(Curve=curve_4, Count=number_slider_4, Kinks=False)  # -> Points, Tangents, Parameters
divide_curve_14 = DivideCurve(Curve=curve_3, Count=number_slider_4, Kinks=False)  # -> Points, Tangents, Parameters
divide_curve_15 = DivideCurve(Curve=curve_5, Count=number_slider_4, Kinks=False)  # -> Points, Tangents, Parameters
divide_curve_16 = DivideCurve(Curve=curve_5, Count=number_slider_4, Kinks=False)  # -> Points, Tangents, Parameters
divide_curve_17 = DivideCurve(Curve=curve_2, Count=number_slider_4, Kinks=False)  # -> Points, Tangents, Parameters
construct_domain_5 = ConstructDomain(DomainStart=Slider(0, range=0..10), DomainEnd=Slider(1, range=0..100))
construct_domain_6 = ConstructDomain(DomainStart=Slider(0, range=0..10), DomainEnd=Slider(1, range=0..100))
construct_domain_7 = ConstructDomain(DomainStart=Slider(0, range=0..10), DomainEnd=Slider(1, range=0..100))
construct_domain_8 = ConstructDomain(DomainStart=Slider(0, range=0..10), DomainEnd=Slider(1, range=0..100))
line_2 = Line(StartPoint=divide_curve_3.Points, EndPoint=divide_curve_2.Points)
construct_domain_9 = ConstructDomain(DomainStart=Slider(0, range=0..10), DomainEnd=Slider(1, range=0..100))
line_3 = Line(StartPoint=divide_curve_5.Points, EndPoint=divide_curve_4.Points)
construct_domain_10 = ConstructDomain(DomainStart=Slider(0, range=0..10), DomainEnd=Slider(1, range=0..100))
line_4 = Line(StartPoint=divide_curve_7.Points, EndPoint=divide_curve_6.Points)
construct_domain_11 = ConstructDomain(DomainStart=Slider(0, range=0..10), DomainEnd=Slider(1, range=0..100))
line_5 = Line(StartPoint=divide_curve_9.Points, EndPoint=divide_curve_8.Points)
construct_domain_12 = ConstructDomain(DomainStart=Slider(0, range=0..10), DomainEnd=Slider(1, range=0..100))
range_3 = Range(Domain=construct_domain_5, Steps=number_slider_4)
line_6 = Line(StartPoint=divide_curve_11.Points, EndPoint=divide_curve_10.Points)
range_4 = Range(Domain=construct_domain_6, Steps=number_slider_4)
range_5 = Range(Domain=construct_domain_7, Steps=number_slider_4)
line_7 = Line(StartPoint=divide_curve_13.Points, EndPoint=divide_curve_12.Points)
line_8 = Line(StartPoint=divide_curve_15.Points, EndPoint=divide_curve_14.Points)
range_6 = Range(Domain=construct_domain_8, Steps=number_slider_4)
line_9 = Line(StartPoint=divide_curve_17.Points, EndPoint=divide_curve_16.Points)
unit_vector = UnitVector(Vector=line_2)
range_7 = Range(Domain=construct_domain_9, Steps=number_slider_4)
unit_vector_2 = UnitVector(Vector=line_3)
unit_vector_3 = UnitVector(Vector=line_4)
unit_vector_4 = UnitVector(Vector=line_5)
range_8 = Range(Domain=construct_domain_10, Steps=number_slider_4)
range_9 = Range(Domain=construct_domain_11, Steps=number_slider_4)
range_10 = Range(Domain=construct_domain_12, Steps=number_slider_4)
graph_mapper_3 = GraphMapper(
    range_3,
    x0=0,
    x1=1,
    y0=0,
    y1=1,
    container_name="Bezier",
    cpx=[0, 0.4221633673, 0.7924185395, 1],
    cpy=[0, 0.2428420782, 0.03635215759, 1])
graph_mapper_4 = GraphMapper(
    range_4,
    x0=0,
    x1=1,
    y0=0,
    y1=1,
    container_name="Bezier",
    cpx=[0, 0.4221633673, 0.7924185395, 1],
    cpy=[0, 0.2428420782, 0.03635215759, 1])
unit_vector_5 = UnitVector(Vector=line_6)
graph_mapper_5 = GraphMapper(
    range_5,
    x0=0,
    x1=1,
    y0=0,
    y1=1,
    container_name="Bezier",
    cpx=[0, 0.4221633673, 0.7924185395, 1],
    cpy=[0, 0.2428420782, 0.03635215759, 1])
graph_mapper_6 = GraphMapper(
    range_6,
    x0=0,
    x1=1,
    y0=0,
    y1=1,
    container_name="Bezier",
    cpx=[0, 0.4221633673, 0.7924185395, 1],
    cpy=[0, 0.2428420782, 0.03635215759, 1])
unit_vector_6 = UnitVector(Vector=line_7)
unit_vector_7 = UnitVector(Vector=line_8)
unit_vector_8 = UnitVector(Vector=line_9)
graph_mapper_7 = GraphMapper(
    range_7,
    x0=0,
    x1=1,
    y0=0,
    y1=1,
    container_name="Bezier",
    cpx=[0, 0.4221633673, 0.7924185395, 1],
    cpy=[0, 0.2428420782, 0.03635215759, 1])
graph_mapper_8 = GraphMapper(
    range_8,
    x0=0,
    x1=1,
    y0=0,
    y1=1,
    container_name="Bezier",
    cpx=[0, 0.4221633673, 0.7924185395, 1],
    cpy=[0, 0.2428420782, 0.03635215759, 1])
graph_mapper_9 = GraphMapper(
    range_9,
    x0=0,
    x1=1,
    y0=0,
    y1=1,
    container_name="Bezier",
    cpx=[0, 0.4221633673, 0.7924185395, 1],
    cpy=[0, 0.2428420782, 0.03635215759, 1])
graph_mapper_10 = GraphMapper(
    range_10,
    x0=0,
    x1=1,
    y0=0,
    y1=1,
    container_name="Bezier",
    cpx=[0, 0.4221633673, 0.7924185395, 1],
    cpy=[0, 0.2428420782, 0.03635215759, 1])
bounds_3 = Bounds(Numbers=graph_mapper_3)
construct_domain_13 = ConstructDomain(DomainStart=number_slider_5, DomainEnd=number_slider_6)
bounds_4 = Bounds(Numbers=graph_mapper_4)
bounds_5 = Bounds(Numbers=graph_mapper_5)
bounds_6 = Bounds(Numbers=graph_mapper_6)
construct_domain_14 = ConstructDomain(DomainStart=number_slider_5, DomainEnd=number_slider_6)
construct_domain_15 = ConstructDomain(DomainStart=number_slider_5, DomainEnd=number_slider_6)
construct_domain_16 = ConstructDomain(DomainStart=number_slider_5, DomainEnd=number_slider_6)
bounds_7 = Bounds(Numbers=graph_mapper_7)
bounds_8 = Bounds(Numbers=graph_mapper_8)
bounds_9 = Bounds(Numbers=graph_mapper_9)
bounds_10 = Bounds(Numbers=graph_mapper_10)
construct_domain_17 = ConstructDomain(DomainStart=number_slider_5, DomainEnd=number_slider_6)
construct_domain_18 = ConstructDomain(DomainStart=number_slider_5, DomainEnd=number_slider_6)
construct_domain_19 = ConstructDomain(DomainStart=number_slider_5, DomainEnd=number_slider_6)
construct_domain_20 = ConstructDomain(DomainStart=number_slider_5, DomainEnd=number_slider_6)
remap_numbers_3 = RemapNumbers(Value=graph_mapper_3, Source=bounds_3, Target=construct_domain_13)  # -> reverse(Mapped), Clipped
multiplication = Multiplication(A=unit_vector, B=remap_numbers_3.Mapped)
remap_numbers_4 = RemapNumbers(Value=graph_mapper_4, Source=bounds_4, Target=construct_domain_14)  # -> reverse(Mapped), Clipped
multiplication_2 = Multiplication(A=unit_vector_2, B=remap_numbers_4.Mapped)
remap_numbers_5 = RemapNumbers(Value=graph_mapper_5, Source=bounds_5, Target=construct_domain_15)  # -> reverse(Mapped), Clipped
# edge 控制
multiplication_3 = Multiplication(A=unit_vector_3, B=remap_numbers_5.Mapped)
remap_numbers_6 = RemapNumbers(Value=graph_mapper_6, Source=bounds_6, Target=construct_domain_16)  # -> reverse(Mapped), Clipped
multiplication_4 = Multiplication(A=unit_vector_4, B=remap_numbers_6.Mapped)
remap_numbers_7 = RemapNumbers(Value=graph_mapper_7, Source=bounds_7, Target=construct_domain_17)  # -> reverse(Mapped), Clipped
multiplication_5 = Multiplication(A=unit_vector_5, B=remap_numbers_7.Mapped)
remap_numbers_8 = RemapNumbers(Value=graph_mapper_8, Source=bounds_8, Target=construct_domain_18)  # -> reverse(Mapped), Clipped
multiplication_6 = Multiplication(A=unit_vector_6, B=remap_numbers_8.Mapped)
remap_numbers_9 = RemapNumbers(Value=graph_mapper_9, Source=bounds_9, Target=construct_domain_19)  # -> reverse(Mapped), Clipped
multiplication_7 = Multiplication(A=unit_vector_7, B=remap_numbers_9.Mapped)
remap_numbers_10 = RemapNumbers(Value=graph_mapper_10, Source=bounds_10, Target=construct_domain_20)  # -> reverse(Mapped), Clipped
multiplication_8 = Multiplication(A=unit_vector_8, B=remap_numbers_10.Mapped)
move_6 = Move(Geometry=divide_curve_3.Points, Motion=multiplication)  # -> Geometry, Transform
move_7 = Move(Geometry=divide_curve_5.Points, Motion=multiplication_2)  # -> Geometry, Transform
move_8 = Move(Geometry=divide_curve_7.Points, Motion=multiplication_3)  # -> Geometry, Transform
move_9 = Move(Geometry=divide_curve_9.Points, Motion=multiplication_4)  # -> Geometry, Transform
move_10 = Move(Geometry=divide_curve_11.Points, Motion=multiplication_5)  # -> Geometry, Transform
move_11 = Move(Geometry=divide_curve_13.Points, Motion=multiplication_6)  # -> Geometry, Transform
move_12 = Move(Geometry=divide_curve_15.Points, Motion=multiplication_7)  # -> Geometry, Transform
move_13 = Move(Geometry=divide_curve_17.Points, Motion=multiplication_8)  # -> Geometry, Transform
line_10 = Line(StartPoint=move_6.Geometry, EndPoint=move_10.Geometry)
line_11 = Line(StartPoint=move_7.Geometry, EndPoint=move_11.Geometry)
line_12 = Line(StartPoint=move_8.Geometry, EndPoint=move_12.Geometry)
line_13 = Line(StartPoint=move_9.Geometry, EndPoint=move_13.Geometry)
point_on_curve = PointOnCurve(line_10, parameter=0.5)
point_on_curve_2 = PointOnCurve(line_11, parameter=0.5)
point_on_curve_3 = PointOnCurve(line_12, parameter=0.5)
point_on_curve_4 = PointOnCurve(line_13, parameter=0.5)
rotate_4 = Rotate(Geometry=line_10, Angle=degrees(Slider(90, range=0..100)), Plane=point_on_curve)  # -> Geometry, Transform
rotate_5 = Rotate(Geometry=line_11, Angle=degrees(Slider(90, range=0..100)), Plane=point_on_curve_2)  # -> Geometry, Transform
rotate_6 = Rotate(Geometry=line_12, Angle=degrees(Slider(90, range=0..100)), Plane=point_on_curve_3)  # -> Geometry, Transform
rotate_7 = Rotate(Geometry=line_13, Angle=degrees(Slider(90, range=0..100)), Plane=point_on_curve_4)  # -> Geometry, Transform
unit_vector_9 = UnitVector(Vector=rotate_4.Geometry)
unit_vector_10 = UnitVector(Vector=rotate_5.Geometry)
unit_vector_11 = UnitVector(Vector=rotate_6.Geometry)
unit_vector_12 = UnitVector(Vector=rotate_7.Geometry)
multiplication_9 = Multiplication(A=unit_vector_9, B=挤出)
move_14 = Move(Geometry=move_10.Geometry, Motion=expr("-x", multiplication_9))  # -> Geometry, Transform
move_15 = Move(Geometry=move_6.Geometry, Motion=expr("-x", multiplication_9))  # -> Geometry, Transform
multiplication_10 = Multiplication(A=unit_vector_10, B=挤出)
multiplication_11 = Multiplication(A=unit_vector_11, B=挤出)
move_16 = Move(Geometry=move_11.Geometry, Motion=expr("-x", multiplication_10))  # -> Geometry, Transform
multiplication_12 = Multiplication(A=unit_vector_12, B=挤出)
move_17 = Move(Geometry=move_7.Geometry, Motion=expr("-x", multiplication_10))  # -> Geometry, Transform
move_18 = Move(Geometry=move_12.Geometry, Motion=expr("-x", multiplication_11))  # -> Geometry, Transform
move_19 = Move(Geometry=move_8.Geometry, Motion=expr("-x", multiplication_11))  # -> Geometry, Transform
move_20 = Move(Geometry=move_13.Geometry, Motion=expr("-x", multiplication_12))  # -> Geometry, Transform
move_21 = Move(Geometry=move_9.Geometry, Motion=expr("-x", multiplication_12))  # -> Geometry, Transform
interpolate_2 = Interpolate(Vertices=move_6.Geometry, Degree=3, Periodic=False, KnotStyle=1)  # -> Curve, Length, Domain
interpolate_3 = Interpolate(Vertices=move_15.Geometry, Degree=3, Periodic=False, KnotStyle=1)  # -> Curve, Length, Domain
interpolate_4 = Interpolate(Vertices=move_14.Geometry, Degree=3, Periodic=False, KnotStyle=1)  # -> Curve, Length, Domain
interpolate_5 = Interpolate(Vertices=move_10.Geometry, Degree=3, Periodic=False, KnotStyle=1)  # -> Curve, Length, Domain
interpolate_6 = Interpolate(Vertices=move_7.Geometry, Degree=3, Periodic=False, KnotStyle=1)  # -> Curve, Length, Domain
interpolate_7 = Interpolate(Vertices=move_17.Geometry, Degree=3, Periodic=False, KnotStyle=1)  # -> Curve, Length, Domain
interpolate_8 = Interpolate(Vertices=move_16.Geometry, Degree=3, Periodic=False, KnotStyle=1)  # -> Curve, Length, Domain
interpolate_9 = Interpolate(Vertices=move_11.Geometry, Degree=3, Periodic=False, KnotStyle=1)  # -> Curve, Length, Domain
interpolate_10 = Interpolate(Vertices=move_8.Geometry, Degree=3, Periodic=False, KnotStyle=1)  # -> Curve, Length, Domain
interpolate_11 = Interpolate(Vertices=move_19.Geometry, Degree=3, Periodic=False, KnotStyle=1)  # -> Curve, Length, Domain
interpolate_12 = Interpolate(Vertices=move_18.Geometry, Degree=3, Periodic=False, KnotStyle=1)  # -> Curve, Length, Domain
interpolate_13 = Interpolate(Vertices=move_12.Geometry, Degree=3, Periodic=False, KnotStyle=1)  # -> Curve, Length, Domain
interpolate_14 = Interpolate(Vertices=move_9.Geometry, Degree=3, Periodic=False, KnotStyle=1)  # -> Curve, Length, Domain
interpolate_15 = Interpolate(Vertices=move_21.Geometry, Degree=3, Periodic=False, KnotStyle=1)  # -> Curve, Length, Domain
interpolate_16 = Interpolate(Vertices=move_20.Geometry, Degree=3, Periodic=False, KnotStyle=1)  # -> Curve, Length, Domain
interpolate_17 = Interpolate(Vertices=move_13.Geometry, Degree=3, Periodic=False, KnotStyle=1)  # -> Curve, Length, Domain
curve_6 = Curve(curve_3)
curve_7 = Curve(curve_4)
curve_8 = Curve(curve_5)
curve_9 = Curve(curve_2)
loft_5 = Loft(
    Curves=flatten([curve_6, interpolate_5.Curve]),
    Options={Adjust=False, Closed=False, LoftEnds=0, LoftSimp=0, LoftType=0, Rebuild=10, Refit=0.01})
loft_6 = Loft(
    Curves=flatten([interpolate_2.Curve, curve_6]),
    Options={Adjust=False, Closed=False, LoftEnds=0, LoftSimp=0, LoftType=0, Rebuild=10, Refit=0.01})
loft_7 = Loft(
    Curves=[interpolate_2.Curve, interpolate_3.Curve],
    Options={Adjust=False, Closed=False, LoftEnds=0, LoftSimp=0, LoftType=0, Rebuild=10, Refit=0.01})
loft_8 = Loft(
    Curves=[interpolate_3.Curve, interpolate_4.Curve],
    Options={Adjust=False, Closed=False, LoftEnds=0, LoftSimp=0, LoftType=0, Rebuild=10, Refit=0.01})
loft_9 = Loft(
    Curves=[interpolate_4.Curve, interpolate_5.Curve],
    Options={Adjust=False, Closed=False, LoftEnds=0, LoftSimp=0, LoftType=0, Rebuild=10, Refit=0.01})
loft_10 = Loft(
    Curves=flatten([curve_7, interpolate_9.Curve]),
    Options={Adjust=False, Closed=False, LoftEnds=0, LoftSimp=0, LoftType=0, Rebuild=10, Refit=0.01})
loft_11 = Loft(
    Curves=flatten([interpolate_6.Curve, curve_7]),
    Options={Adjust=False, Closed=False, LoftEnds=0, LoftSimp=0, LoftType=0, Rebuild=10, Refit=0.01})
loft_12 = Loft(
    Curves=flatten([curve_8, interpolate_13.Curve]),
    Options={Adjust=False, Closed=False, LoftEnds=0, LoftSimp=0, LoftType=0, Rebuild=10, Refit=0.01})
loft_13 = Loft(
    Curves=flatten([interpolate_10.Curve, curve_8]),
    Options={Adjust=False, Closed=False, LoftEnds=0, LoftSimp=0, LoftType=0, Rebuild=10, Refit=0.01})
loft_14 = Loft(
    Curves=[interpolate_6.Curve, interpolate_7.Curve],
    Options={Adjust=False, Closed=False, LoftEnds=0, LoftSimp=0, LoftType=0, Rebuild=10, Refit=0.01})
loft_15 = Loft(
    Curves=[interpolate_7.Curve, interpolate_8.Curve],
    Options={Adjust=False, Closed=False, LoftEnds=0, LoftSimp=0, LoftType=0, Rebuild=10, Refit=0.01})
loft_16 = Loft(
    Curves=[interpolate_8.Curve, interpolate_9.Curve],
    Options={Adjust=False, Closed=False, LoftEnds=0, LoftSimp=0, LoftType=0, Rebuild=10, Refit=0.01})
loft_17 = Loft(
    Curves=flatten([curve_9, interpolate_17.Curve]),
    Options={Adjust=False, Closed=False, LoftEnds=0, LoftSimp=0, LoftType=0, Rebuild=10, Refit=0.01})
loft_18 = Loft(
    Curves=flatten([interpolate_14.Curve, curve_9]),
    Options={Adjust=False, Closed=False, LoftEnds=0, LoftSimp=0, LoftType=0, Rebuild=10, Refit=0.01})
loft_19 = Loft(
    Curves=[interpolate_10.Curve, interpolate_11.Curve],
    Options={Adjust=False, Closed=False, LoftEnds=0, LoftSimp=0, LoftType=0, Rebuild=10, Refit=0.01})
loft_20 = Loft(
    Curves=[interpolate_11.Curve, interpolate_12.Curve],
    Options={Adjust=False, Closed=False, LoftEnds=0, LoftSimp=0, LoftType=0, Rebuild=10, Refit=0.01})
loft_21 = Loft(
    Curves=[interpolate_12.Curve, interpolate_13.Curve],
    Options={Adjust=False, Closed=False, LoftEnds=0, LoftSimp=0, LoftType=0, Rebuild=10, Refit=0.01})
loft_22 = Loft(
    Curves=[interpolate_14.Curve, interpolate_15.Curve],
    Options={Adjust=False, Closed=False, LoftEnds=0, LoftSimp=0, LoftType=0, Rebuild=10, Refit=0.01})
loft_23 = Loft(
    Curves=[interpolate_15.Curve, interpolate_16.Curve],
    Options={Adjust=False, Closed=False, LoftEnds=0, LoftSimp=0, LoftType=0, Rebuild=10, Refit=0.01})
loft_24 = Loft(
    Curves=[interpolate_16.Curve, interpolate_17.Curve],
    Options={Adjust=False, Closed=False, LoftEnds=0, LoftSimp=0, LoftType=0, Rebuild=10, Refit=0.01})
brep_join_2 = BrepJoin(Breps=flatten([loft_7, loft_8, loft_9, loft_5, loft_6]))  # -> Breps, Closed
brep_join_3 = BrepJoin(Breps=flatten([loft_14, loft_15, loft_16, loft_10, loft_11]))  # -> Breps, Closed
brep_join_4 = BrepJoin(Breps=flatten([loft_19, loft_20, loft_21, loft_12, loft_13]))  # -> Breps, Closed
brep_join_5 = BrepJoin(Breps=flatten([loft_22, loft_23, loft_24, loft_17, loft_18]))  # -> Breps, Closed
cap_holes_2 = CapHoles(Brep=brep_join_2.Breps)
cap_holes_3 = CapHoles(Brep=brep_join_3.Breps)
cap_holes_4 = CapHoles(Brep=brep_join_4.Breps)
cap_holes_5 = CapHoles(Brep=brep_join_5.Breps)

# ----
# Edge 结果
merge = Merge(Data1=cap_holes_4, Data2=cap_holes_5, Data3=cap_holes_3, Data4=cap_holes_2)
